# Dynamo graph DynamoToFlux.dyn (Dynamo 1.2.0.2690)

# group: Flux Project
# note: Web-based Parametric BIM: A Prototype
# Sample 1. The sample demonstrate that Dynamo can be a visual programming tool to update data on the Web (through Flux)
# The Flux data (transformation values) will automatically update a  BIM model displayed in Autodesk Forge Viewer, through a Viewer API program (in Javascript).
# In a simular case, Grasshopper can be used in place of Dynamo to make the demonstration. This means that different users using different tools can work on the same model on the Web collaboratively.
# Wei Yan, Ph.D.
# Texas A&M University
# 10/31/2016
flux_project = ProjectsNodeModel()

# group: Transformations
translate_integer_slider = IntegerSlider(0, range=0..100 step 1)
scale_number_slider = DoubleSlider(1, range=1..2 step 0.1)
rotate_integer_slider = IntegerSlider(0, range=0..360 step 1)

# group: Export to Flux - translate
flow_control = FlowControlNodeModel()
send_to_flux = ToFluxNodeModel(flux_project, flow_control, translate_integer_slider)

# group: Export to Flux - scale
flow_control_2 = FlowControlNodeModel()
send_to_flux_2 = ToFluxNodeModel(flux_project, flow_control_2, scale_number_slider)

# group: Export to Flux - rotate
flow_control_3 = FlowControlNodeModel()
send_to_flux_3 = ToFluxNodeModel(flux_project, flow_control_3, rotate_integer_slider)
