# Grasshopper definition GrasshopperToFlux.gh (Grasshopper 0.9.76)
# plug-ins: Flux.Grasshopper

flow_control = FlowControl({"Once", "Constantly"}, selected="Constantly")
# Web-based Parametric BIM: A Prototype
# 
# Sample 1. The sample demonstrate that Grasshopper can be a visual programming tool to update data on the Web (through Flux)
# 
# The Flux data (transformation values) will automatically update a  BIM model displayed in Autodesk Forge Viewer, through a Viewer API program (in Javascript).
# 
# In a simular case, Dynamo can be used in place of Dynamo to make the demonstration. This means that different users using different tools can work on the same model on the Web collaboratively.
# 
# Wei Yan, Ph.D.
# Texas A&M University
# 11/6/2016
flux = FluxProject(project="aVoNpEDnDeR68njAR")  # -> Keys, Meta

# ---- group: Export to Flux - translate
to_flux = ToFlux(
    Keys=flux.Keys,
    Value=flatten(Slider(0, range=0..100)),
    Mode=flow_control,
    isNotificationEnabled=True,
    keyId="405f08e52e2454c97f99e0d1d88e6b9d",
    projectId="aVoNpEDnDeR68njAR",
    Branch0_Path="{0}",
    Branch0_Item0_number=0,
    Branch0_Item0_TypeName="Grasshopper.Kernel.Types.GH_Number")

# ---- group: Export to Flux - scale
number_slider = Slider(1, range=1..3)
to_flux_2 = ToFlux(
    Keys=flux.Keys,
    Value=flatten(number_slider),
    Mode=flow_control,
    isNotificationEnabled=True,
    keyId="4051e5d50860a0ea9e5d748a99064494",
    projectId="aVoNpEDnDeR68njAR",
    Branch0_Path="{0}",
    Branch0_Item0_number=1,
    Branch0_Item0_TypeName="Grasshopper.Kernel.Types.GH_Number")

# ---- group: Export to Flux - rotate
number_slider_2 = Slider(0, range=0..360)
to_flux_3 = ToFlux(
    Keys=flux.Keys,
    Value=flatten(number_slider_2),
    Mode=flow_control,
    isNotificationEnabled=True,
    keyId="40aee7b132551fb0caae086ca9685c6f",
    projectId="aVoNpEDnDeR68njAR",
    Branch0_Path="{0}",
    Branch0_Item0_number=0,
    Branch0_Item0_TypeName="Grasshopper.Kernel.Types.GH_Number")

# ----
pt = ConstructPoint(XCoordinate="-15", YCoordinate="-15", ZCoordinate="0")
pt_2 = ConstructPoint(XCoordinate="-25", YCoordinate="-12.5", ZCoordinate="0")
pt_3 = ConstructPoint(XCoordinate="25", YCoordinate="12.5", ZCoordinate="0")
pt_4 = ConstructPoint(XCoordinate="-25", YCoordinate="12.5", ZCoordinate="0")
pt_5 = ConstructPoint(XCoordinate="25", YCoordinate="-12.5", ZCoordinate="0")
rec_2pt = Rectangle2Pt(Plane=PlaneXY(0, 0, 0), PointA=pt_2, PointB=pt_3, Radius=0)  # -> Rectangle, Length
scale = Scale(Geometry=rec_2pt.Rectangle, Center=Point(0, 0, 0), Factor=number_slider)  # -> Geometry, Transform
rotate = Rotate(Geometry=scale.Geometry, Angle=expr("rad(x)", number_slider_2), Plane=PlaneXY(0, 0, 0))  # -> Geometry, Transform
incurve = PointInCurve(Point=pt, Curve=rotate.Geometry)  # -> Relationship, Point
incurve_2 = PointInCurve(Point=[pt_2, pt_3, pt_5, pt_4], Curve=rotate.Geometry)  # -> Relationship, Point
panel = Panel(incurve_2.Relationship)
panel_2 = Panel(incurve.Relationship)
ma = MassAddition(Input=[panel_2, panel])  # -> Result, PartialResults
panel_3 = Panel(ma.Result)
panel_4 = Panel(number_slider)
subtraction = Subtraction(A=panel_3, B=panel_4)

galapagos = Galapagos(fitness=subtraction, gene=[number_slider, number_slider_2])
